# Grasshopper definition MocapDemo-garthz.gh (Grasshopper 0.9.76)
# plug-ins: Python Interpreter

# ----
# Mocap Stream Receiver
# Construct coordinate axes for each object
# from the origin point and  unit basis vectors.
# 
# Note that these have been rotated from
# Optitrack XZ ground plane conventions to
# Rhino XY ground plane conventions.
timer = Timer(TimerInterval=50, Target=mocapreceiver)  # disabled
mocapreceiver = PythonScript(reset=Toggle(False), version="2800")  # -> out, received, names, planes; inputs reset: Boolean
# ---------- mocapreceiver: Python ----------
# MocapReceiver.py - the motion capture script in the ghpython object in MocapDemo.gh

# Demonstration of receiving and parsing an Optitrack motion capture real-time stream.
# This is normally polled from a timer.
#
# inputs
#   reset   - Boolean flag to reset the receiver system
#   version - string defining the protocol version number (e.g. "2900" for Motive 1.9)
#
# outputs
#   out      - debugging text stream
#   received - integer number of new frames received
#   planes   - list of Plane objects or None, one per rigid body stream

# use persistent state context
import scriptcontext

# import the Optitrack stream receiver
# reload(optirecv)
import optirecv

# If the user reset input is set, then clear any existing state and do nothing.
if reset:
    print "Resetting receiver state."
    scriptcontext.sticky['mocap_port'] = None
 
else:
    # fetch or create the persistent motion capture streaming receiver port
    port = scriptcontext.sticky.get('mocap_port')
    if port is None:
        port = optirecv.OptitrackReceiver(version)
        scriptcontext.sticky['mocap_port'] = port

    # Poll the port as long as data is available, accumulating all
    # frames.  It is unlikely that Grasshopper will keep up with the
    # 120 Hz mocap sampling rate, butit is important to have the
    # continuous trajectory available for analysis and recording.
    receiving = True
    frames = list()
    while receiving:
        receiving = port.poll()
        if receiving:
            frames.append(port.make_plane_list())

    # Convert the frame list into a data tree for output.  As accumulated, it is a Python list of lists:
    # [[body1_sample0, body2_sample0, body3_sample0, ...], [body1_sample1, body2_sample1, body3_sample1, ...], ...]
    planes = optirecv.frames_to_tree(frames)
    received = len(frames)
    
    # Emit the list of body names in the order corresponding to the
    # branches in the trajectory data tree.  The ordering is stable as
    # determined by the configuration in the Motive project.
    names  = port.bodynames
# ---------- end mocapreceiver ----------
panel = Panel(mocapreceiver.out)
panel_2 = Panel(mocapreceiver.received)
panel_3 = Panel(mocapreceiver.planes)

stride = Slider(1, range=1..20)

# ----
# Mocap CSV File Loader
# Note: the Mocap CSV loader rotates
# the input data from the XZ ground plane
# convention of the Optitrack system
# to a XY Rhino ground plane convention.
path = FilePath("C:\Users\garthz\src\cmuphyscomp\hmv-s16\debugging\mocapdata\regular Gesture flicks 2016-02-04 11.14.10 AM.csv")
panel_4 = Panel(path)
csv_loader = PythonScript(path=panel_4, stride=stride)  # -> out, names, planes
# ---------- csv_loader: Python ----------
# CSVLoader.py - the file loader script in the ghpython object in MocapDemo.gh.

# Demonstration of parsing an Optitrack motion capture CSV file.
#
# inputs
#   path    - string with the full path to the CSV file
#   stride  - the sequence interval between successive points; 1 returns all points, >1 subsamples
#
# outputs
#   out      - debugging text stream
#   names    - data tree of body names
#   planes   - data tree of Plane trajectories, one branch per rigid body, each leaf a list of Planes

# import the Optitrack file loader from the same folder
import optiload

# load the file
take = optiload.load_csv_file(path)

print "Found rigid bodies:", take.rigid_bodies.keys()

# emit all return values
names = take.rigid_bodies.keys()
planes = optiload.all_Planes(take, int(stride))
# ---------- end csv_loader ----------
panel_5 = Panel(csv_loader.out)
panel_6 = Panel(csv_loader.names)
pln = Plane(csv_loader.planes)
panel_7 = Panel(csv_loader.planes)
viewer = ParamViewer(csv_loader.planes)
viewer_2 = ParamViewer(csv_loader.planes)

panel_8 = Panel(mocapreceiver.names)
pln_2 = Plane(mocapreceiver.planes)
multiplication = Multiplication(A=Slider(0, range=0..500), B=5)
viewer_3 = ParamViewer(csv_loader.names)
xy = XYPlane(Origin=Point(0, 0, 0))

# ----
# show one
# mocap trajectory
rigid_body = Slider(0, range=0..4)
merge = Merge(Data1="0", Data2=rigid_body)
path_2 = ConstructPath(Indices=merge)
branch = TreeBranch(Tree=pln, Path=path_2, MaintainPaths=True)
pt = Point([Point(0, 0.1, 0), Point(0, 0, 0), Point(0.1, 0, 0)])
pline = PolyLine(Vertices=pt, Closed=False)
orient = Orient(Geometry=pline, Source=xy, Target=branch)  # -> Geometry, Transform

cone = Cone(Base=PlaneXY(0, 0, 0), Radius=0.1, Length=0.2)  # -> Cone, Tip
xy_2 = XYPlane(Origin=Point(0, 0, 0))

# ----
# separate out Gesture trajectory
# show one
# mocap trajectory
rigid_body_2 = Slider(2, range=0..4)
merge_2 = Merge(Data1="0", Data2=rigid_body_2)
path_3 = ConstructPath(Indices=merge_2)
branch_2 = TreeBranch(Tree=pln_2, Path=path_3, MaintainPaths=True)
pt_2 = Point([Point(0, 0.1, 0), Point(0, 0, 0), Point(0.1, 0, 0)])
pline_2 = PolyLine(Vertices=pt_2, Closed=False)
xy_3 = XYPlane(Origin=Point(0, 0, 0))
orient_2 = Orient(Geometry=pline_2, Source=xy_3, Target=branch_2)  # -> Geometry, Transform

orient_3 = Orient(Geometry=cone.Cone, Source=xy_2, Target=pln_2)  # -> Geometry, Transform
# separate out Cursor trajectory
rigid_body_3 = Slider(1, range=0..4)
merge_3 = Merge(Data1="0", Data2=rigid_body_3)
path_4 = ConstructPath(Indices=merge_3)
branch_3 = TreeBranch(Tree=pln_2, Path=path_4, MaintainPaths=True)

# ----
# show mocap
# playback
# playback group size
rewind_playback = Button()
enable_playback = BooleanToggle(True)
lng = ListLength(List=branch)
subtraction = Subtraction(A="5", B=1)
timer_2 = Timer(TimerInterval=50, Target=counter)  # disabled
counter = PythonScript(name="playback_counter", enable=enable_playback, reset=rewind_playback, low=0, high=lng, step="5")  # -> out, value; inputs enable: Boolean, reset: Boolean, low: Int32, high: Int32, step: Int32
# ---------- counter: Python ----------
# Counter.py - general purpose counter block for use in ghpython object
# inputs
#  name   - counter name token string
#  enable - bool to enable counting
#  reset  - bool to reset to lowest value
#  low    - lowest output value
#  high   - upper bound on output value
#  step   - interval to step

# outputs
#   value - integer count value

import scriptcontext as sc

value = sc.sticky.get(name)

if value is None or reset or value >= high:
    value = low

elif enable:
    value = value + step

sc.sticky[name] = value
print value
# ---------- end counter ----------
panel_9 = Panel(counter.value)
pt2num = NumbersToPoints(Numbers=[0, 0, 0], Mask=4)
pt2num_2 = NumbersToPoints(Numbers=[0, 0.2, 0], Mask=4)
ln = Line(StartPoint=pt2num, EndPoint=pt2num_2)
xy_4 = XYPlane(Origin=Point(0, 0, 0))

int = Integer(counter.value)

addition = Addition(A=int, B=subtraction)
dom = ConstructDomain(DomainStart=int, DomainEnd=addition)
subset = SubList(List=branch, Domain=dom, Wrap=False)  # -> List, Index
panel_10 = Panel(subset.List)
orient_4 = Orient(Geometry=ln, Source=xy_4, Target=subset.List)  # -> Geometry, Transform

filter = StreamFilter(Gate=Slider(0, range=0..1), Stream0=branch_2, Stream1=subset.List)

# ----
# Detect quick flicking motions
deplane = DeconstructPlane(Plane=filter)  # -> Origin, XAxis, YAxis, ZAxis
multiplication_2 = Multiplication(A=deplane.YAxis, B=0.2)
addition_2 = Addition(A=deplane.Origin, B=multiplication_2)
threshold = Slider(100, range=100..300)
pt_3 = Point(addition_2)
detectflick = PythonScript(reset=Button(), points=pt_3, threshold=threshold)  # -> out, flick, sample; inputs points: list of Point3d
# ---------- detectflick: Python ----------
# DetectFlick.py - contents of the ghpython object in MocapDemo.gh
#
# inputs
#   reset   - Boolean to deactivate and reset state
#   points  - list of Point3D objects representing the path of the tip of an indicating stick
#             Note: the 'points' input must be set to 'List Access'
# threshold - the acceleration value above which to output an event

# outputs
#   out      - debugging text stream
#   flick    - true if a flick event is detected
#   sample   - sample offset for the flick event; zero is 'now', negative values are relative to now.

# use persistent state context
import scriptcontext
sc_identifier = 'flick_detector'

# use point filter with acceleration estimator
try:
    reload(pointfilter)
except:
    print "Loading for first time, can't reload."
    
import pointfilter

# If the user reset input is set, then clear any existing state and do nothing.
if reset:
    print "Resetting receiver state."
    scriptcontext.sticky[sc_identifier] = None 

else:
    # fetch or create the persistent motion capture streaming receiver port
    filter = scriptcontext.sticky.get(sc_identifier)
    if filter is None:
        filter = pointfilter.Point3dFilter(20)
        scriptcontext.sticky[sc_identifier] = filter
        
    # add the new data
    filter.add_points(points)
    # print filter._position
    # print "Adding %d points to filter." % len(points)
    # offset, mag, acc, pos = filter.find_accel_peak()
    # print "Peak at %d of %f" % (offset, mag)
    
    flick, sample = filter.detect_acceleration_event( threshold )
    if flick:
        print "Acceleration peak observed at %d" % sample
    
    print "Filter has seen %d points, buffer starts at %d, blanking ends at %d." % (filter.samples, filter.samples - filter._buf_len, filter.last_event + filter.blanking)
# ---------- end detectflick ----------
panel_11 = Panel(detectflick.out)
panel_12 = Panel(detectflick.sample)
panel_13 = Panel(detectflick.flick)

# ----
# show indicated poses
erase = Button()
planerecord = PythonScript(inputs=filter, capture=detectflick.sample, clear=erase)  # -> out, planes; inputs inputs: list of Plane, capture: Int32, clear: Boolean
# ---------- planerecord: Python ----------
# PlaneRecord.py - the plane data recording script in the ghpython object in MocapDemo.gh.
#
# inputs
#  inputs   - list of Plane objects
#  capture  - None or integer sample time offset indicating which recent object should be added to the set
#  clear    - Boolean indicating the the data set should be erased
#  N.B. the 'inputs' input must be set to 'List Access'
#  N.B. the 'capture' input should have a type hint of Int

# other ideas:
#   path       - string with the full path to the CSV file
#   selection  - currently selected set

# outputs
#   out      - debugging text stream
#   planes   - list of Plane objects

# use RhinoCommon API
import Rhino

# use persistent state context
import scriptcontext

# use the history utility class
import historybuffer

################################################################
class PlaneRecorder(object):
    def __init__(self):
        # list of selected objects
        self.planes = []
 
        # keep track of about a quarter-second of mocap data
        self.buffer = historybuffer.History(30)
        return

    def add_planes(self, planes):
        if planes is not None:
            self.buffer.append(planes)
        return
    
    def capture_plane(self, offset):
        self.planes.append(self.buffer[offset])
        return

################################################################
if clear:
    # create an empty data recorder
    recorder = PlaneRecorder()
    scriptcontext.sticky['plane_recorder'] = recorder

else:
    # fetch or create a persistent data recorder
    recorder = scriptcontext.sticky.get('plane_recorder')
    if recorder is None:
        recorder = PlaneRecorder()
        scriptcontext.sticky['plane_recorder'] = recorder
    recorder.add_planes(inputs)

if capture is not None:
    recorder.capture_plane(capture)
 
planes = recorder.planes
print "Buffer has seen %d planes, currently holding %d selected planes." % (recorder.buffer.samples, len(planes))
# ---------- end planerecord ----------
pln_3 = Plane(planerecord.planes)
xy_5 = XYPlane(Origin=Point(0, 0, 0))
cone_2 = Cone(Base=PlaneXY(0, 0, 0), Radius=0.1, Length=0.2)  # -> Cone, Tip
panel_14 = Panel(planerecord.out)
orient_5 = Orient(Geometry=cone_2.Cone, Source=xy_5, Target=pln_3)  # -> Geometry, Transform

panel_15 = Panel(pln_3)
